% Simulink data dictionary eomParameters.sldd

A = Simulink.Parameter(1)
B = Simulink.Parameter(1)
C = Simulink.Parameter(1)
D = Simulink.Parameter(1)
E = Simulink.Parameter(1)
F = Simulink.Parameter(1)
G = Simulink.Parameter(1)
H = Simulink.Parameter(1)
I = Simulink.Parameter(1)
J = Simulink.Parameter(1)
K = Simulink.Parameter(1)